% Simulink data dictionary quadCopterDD.sldd

Run_on_Hardware_Configuration = Simulink.ConfigSet(StartTime="0", StopTime="inf", FixedStep="1/1000", Solver="ode3", ProdHWDeviceType="ARM Compatible->ARM Cortex", SystemTargetFile="ert.tlc", HardwareBoard="Raspberry Pi", TargetLang="C")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
Ts = 0.005
aMean = [-0.03857923; 0.01512541; 0.9852643]
aVar = [5.125378e-06; 4.227782e-06; 1.191566e-05]
gMean = [-0.007051159; 0.003828555; 0.01116603]
gVar = [6.698329e-07; 1.243894e-06; 7.199293e-07]
mMean = [47.73571; -38.63601; 87.51719]
mVar = [39.43076; 40.81592; 35.44471]
Run_on_Hardware_Configuration2 = Simulink.ConfigSet(StartTime="0", StopTime="inf", FixedStep="1/1000", Solver="ode3", ProdHWDeviceType="ARM Compatible->ARM Cortex", SystemTargetFile="ert.tlc", HardwareBoard="Raspberry Pi", TargetLang="C")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
Pinit = single([2.1551e-9 3.2026e-9 1.2976e-8 2.6121e-9 0.00026915 0.00027861 0.00024193])